vi "Boolean Strings.gvi"   [LabVIEW NXG 5.0.0]
inputs:
  "Customer True Boolean Strings": string[]
  "Customer False Boolean Strings": string[]
  "Enum": enum{"List", "Add", "Remove"} = "List", required
outputs:
  "Array": string[]
  "True Boolean Strings": string[]
  "False Boolean Strings": string[]
  "Numeric": i32
diagram:
  s1 = uninitialised  # shift register
  s2 = uninitialised  # shift register
  s3 = uninitialised  # shift register
  s4 = uninitialised  # shift register
  while {
    Is First Call() -> w1
    case (w1) {
      frame False, Default {
        w2 = s2
        w3 = s3
      }
      frame True {
        w4 = ["1", "Active", "Affirmed", "Enable", "Established", "Existing", "Non-null", "On", "operational", "T", "True", "valid", "yes"]
        w5 = ["0", "Abolished", "Close", "Disable", "F", "False", "Inactive", "Inoperative", "Invalid", "Locked", "Negated", "no", "Nonexistent", "Off", "void", "null"]
        w2 = w4
        w3 = w5
      }
    }
    case ($Enum) {
      frame "List", Default {
        w6 = w2
        w7 = w3
        w8 = default
      }
      frame "Add" {
        To Lower Case(string=w2) -> w9
        To Lower Case(string=$"Customer True Boolean Strings") -> w10
        for {
          w11 = each element of w9
          Search 1D Array(1D array=w10, element=w11) -> (index of element=w13)
          Is Less Than 0(x=w13) -> w14
          append w11 to w12 if w14
        }
        Build Array(w12, $"Customer True Boolean Strings") -> w6
        To Lower Case(string=w3) -> w15
        To Lower Case(string=$"Customer False Boolean Strings") -> w16
        for {
          w17 = each element of w15
          Search 1D Array(1D array=w16, element=w17) -> (index of element=w19)
          Is Less Than 0(x=w19) -> w20
          append w17 to w18 if w20
        }
        Build Array(w18, $"Customer False Boolean Strings") -> w7
        w8 = TRUE
      }
      frame "Remove" {
        To Lower Case(string=w2) -> w21
        To Lower Case(string=$"Customer True Boolean Strings") -> w22
        for {
          w23 = each element of w21
          Search 1D Array(1D array=w22, element=w23) -> (index of element=w24)
          Is Less Than 0(x=w24) -> w25
          append w23 to w6 if w25
        }
        To Lower Case(string=w3) -> w26
        To Lower Case(string=$"Customer False Boolean Strings") -> w27
        for {
          w28 = each element of w26
          Search 1D Array(1D array=w27, element=w28) -> (index of element=w29)
          Is Less Than 0(x=w29) -> w30
          append w28 to w7 if w30
        }
        w8 = TRUE
      }
    }
    Logical Or(w8, w1) -> w31
    case (w31) {
      frame False, Default {
        w32 = s4
        w33 = s1
        w34 = w6
        w35 = w7
      }
      frame True {
        Array Size(array=w6) -> (size(s)=w32)
        Build Array(w6, w7) -> w36
        To Lower Case(string=w36) -> w33
        w34 = w6
        w35 = w7
      }
    }
    next s1 = w33
    next s2 = w34
    next s3 = w35
    next s4 = w32
    stop if TRUE
  }
  $Numeric <- s4
  $Array <- s1
  $"True Boolean Strings" <- s2
  $"False Boolean Strings" <- s3
