vi "Compare Two Numbers_csm.gvi"   [LabVIEW NXG 5.0.0]
inputs:
  "Number": f64, required
  "Ref": f64, required
outputs:
  "Number (dup)": f64
  "Result": enum{"Greater", "Equal", "Less"}
  "Ref (dup)": f64
diagram:
  Is Equal(x=$Number, y=$Ref) -> w1
  case (w1) {
    frame False, Default {
      Is Greater(x=$Number, y=$Ref) -> w5
      Select(s=w5, t="Greater", f="Less") -> w2
      w3 = $Number
      w4 = $Ref
    }
    frame True {
      w2 = "Equal"
      w3 = $Number
      w4 = $Ref
    }
  }
  $"Number (dup)" <- w3
  $Result <- w2
  $"Ref (dup)" <- w4
