vi "Match Multiple Pattern_csm.gvi"   [G Web Development Software 22.0.0]
# Searches for regular expression sequentially in string beginning at offset. If the function finds the first match, it splits string into three substrings.
# As a supplement to Match Pattern Function, regular expression can include mutiple regular expression, and they are separated by delimiter.
inputs:
  "string": string, required
  "regular expression": string, required
  "offset (0)": i32
  "delimiter (|)": string = "|"
outputs:
  "pattern matched": string
  "before substring": string
  "match substring": string
  "after substring": string
  "Found?": bool
uses:
  OpenG.String::String to 1D Array.gvi
  Library::Trim Both Whitespace.gvi
diagram:
  call "String to 1D Array.gvi"(string=$"regular expression", delimiter (Tab)=$"delimiter (|)") -> (Array of Strings=w1)
  for {
    w2 = each element of w1
    call "Trim Both Whitespace.gvi"(string=w2) -> (trimmed string=w4)  # Trim Both Whitespace (CSM)
    Match Pattern(offset (0)=$"offset (0)", regular expression=w4, string=$string) -> (after substring=w5, before substring=w6, match substring=w7, offset past match=w8)
    Is Greater Or Equal To 0(x=w8) -> w9
    w3 = w4 if w9
    stop if w9
  }
  $"before substring" <- w6
  $"match substring" <- w7
  $"after substring" <- w5
  $"Found?" <- w9
  $"pattern matched" <- w3
