vi "Replace Tokens in String.gvi"   [G Web Development Software 22.0.0]
inputs:
  "replace all? (F)": bool = TRUE
  "String": string
  "search string": string = ","
outputs:
  "string_2": string
uses:
  NI::G Core::Strings::Trim Whitespace.gvi
  OpenG.String::String to 1D Array.gvi
diagram:
  case ($"replace all? (F)") {
    frame False, Default {
      Match Pattern(regular expression=$String, string=$"search string") -> (after substring=w2, before substring=w3)
      Concatenate Strings(w3, w2) -> w1
    }
    frame True {
      call "Trim Whitespace.gvi"(string=$String) -> (trimmed string=w4)
      call "String to 1D Array.gvi"(string=w4, delimiter (Tab)=$"search string") -> (Array of Strings=w5)
      Concatenate Strings(w5) -> w1
    }
  }
  $string_2 <- w1
