vi "String To Number(I64)_csm.gvi"   [G Web Development Software 22.0.0]
inputs:
  "String": string, required
outputs:
  "Numeric(I64)": u64
uses:
  Library::Replace Tokens in String.gvi
  Library::Trim Both Whitespace.gvi
  Library::Match Multiple Pattern_csm.gvi
  Library::Compare Two Numbers_csm.gvi
diagram:
  call "Replace Tokens in String.gvi"(String=$String, search string=",", replace all? (F)=TRUE) -> (string_2=w1)
  call "Trim Both Whitespace.gvi"(string=w1) -> (trimmed string=w2)  # Trim Both Whitespace (CSM)
  call "Match Multiple Pattern_csm.gvi"(string=w2, regular expression="^0[xX] | H$ | ^0[oO] | O$ | ^0[bB] | B$ | ^0[dD]") -> (pattern matched=w3, before substring=w4, after substring=w5, Found?=w6)  # Match multiple Pattern (CSM)
  w7 = 0  # I64
  case (w6) {
    frame False, Default {
      call "Match Multiple Pattern_csm.gvi"(string=w2, regular expression="[Kk]$ | M$") -> (before substring=w9, match substring=w10)  # Match multiple Pattern (CSM)
      case (w10) {
        frame "K", "k" {
          Decimal String To Number(default (0 I32)=w7, string=w9) -> (number=w11)
          call "Compare Two Numbers_csm.gvi"(Number=w11, Ref=0) -> (Result=w12)  # Compare Two Numbers (CSM)
          case (w12) {
            frame "Greater", Default {
              Multiply(w11, 1000) -> w8
            }
            frame "Equal" {
              w8 = 0
            }
            frame "Less" {
              Multiply(w11, 1000) -> w8
            }
          }
        }
        frame "M" {
          Decimal String To Number(default (0 I32)=w7, string=w9) -> (number=w13)
          call "Compare Two Numbers_csm.gvi"(Number=w13, Ref=0) -> (Result=w14)  # Compare Two Numbers (CSM)
          case (w14) {
            frame "Greater", Default {
              Multiply(w13, 1000000) -> w8
            }
            frame "Equal" {
              w8 = 0
            }
            frame "Less" {
              Multiply(w13, 1000000) -> w8
            }
          }
        }
        frame "", Default {
          Decimal String To Number(default (0 I32)=w7, string=w9) -> (number=w8)
        }
      }
    }
    frame True {
      case (w3) {
        frame Default {
          w8 = w7
        }
        frame "^0[xX]" {
          Hexadecimal String To Number(default (0 U32)=w7, string=w5) -> (number=w8)
        }
        frame "^0[dD]" {
          Decimal String To Number(default (0 I32)=w7, string=w5) -> (number=w8)
        }
        frame "H$" {
          Hexadecimal String To Number(default (0 U32)=w7, string=w4) -> (number=w8)
        }
        frame "^0[oO]" {
          Octal String To Number(default (0 U32)=w7, string=w5) -> (number=w8)
        }
        frame "O$" {
          Octal String To Number(default (0 U32)=w7, string=w4) -> (number=w8)
        }
        frame "^0[bB]" {
          # boolean array should always be converted to U64
          String To Byte Array(encoding="Extended ASCII", string=w5) -> (unsigned byte array=w15)
          Is Not Equal(x=w15, y=0x30) -> w16
          Reverse 1D Array(array=w16) -> (reversed array=w17)
          Boolean Array To Number[SignExtensionMode=1](Boolean array=w17) -> (number=w8: u64)
        }
        frame "B$" {
          # boolean array should always be converted to U64
          String To Byte Array(encoding="Extended ASCII", string=w4) -> (unsigned byte array=w18)
          Is Equal(x=w18, y=0x30) -> w19
          Reverse 1D Array(array=w19) -> (reversed array=w20)
          Boolean Array To Number[SignExtensionMode=1](Boolean array=w20) -> (number=w8: u64)
        }
      }
    }
  }
  $"Numeric(I64)" <- w8
