vi "String to Boolean_csm.gvi"   [LabVIEW NXG 5.0.0]
# If the input string is one of "1", "Active", "Affirmed", "Enable", "Established", "Existing", "Non-null", "On", "operational", "T", "True", "valid" , the output will be ture; if the input string is one of "0", "Abolished", "Close", "Disable", "F", "False", "Inactive", "Inoperative", "Invalid", "Locked", "Negated", "Nonexistent", "Off", "void" , the output will be false; otherwise, the outputs follows the default boolean control.
inputs:
  "String": string, required
  "Default(F)": bool
outputs:
  "Boolean": bool
uses:
  Library::Boolean Strings.gvi
  Library::Trim Both Whitespace.gvi
diagram:
  call "Boolean Strings.gvi"(Enum="List") -> (Array=w1, Numeric=w2)  # Boolean Strings (CSM)
  call "Trim Both Whitespace.gvi"(string=$String) -> (trimmed string=w3)  # Trim Both Whitespace (CSM)
  To Lower Case(string=w3) -> w4
  Search 1D Array(1D array=w1, element=w4) -> (index of element=w5)
  case (w5) {
    frame 0.. {
      Is Less(x=w5, y=w2) -> w6
    }
    frame Default {
      w6 = $"Default(F)"
    }
  }
  $Boolean <- w6
