vi "Trim Both Whitespace.gvi"   [LabVIEW NXG 5.0.0]
# Remove all ASCII whitespace characters (spaces, tabs, carriage returns, and line feeds) from the beginning, end, or both.
# -- Controls --
# - string: String to be processed
# -- Indicators --
# - trimmed string: Processed string
inputs:
  "string": string, required  # String to be processed
outputs:
  "trimmed string": string  # Processed string
diagram:
  Match Pattern(regular expression="^[\\t\\n\\r\\s]*", string=$string) -> (after substring=w1)
  Match Pattern(regular expression="[\\t\\n\\r\\s]*$", string=w1) -> (before substring=w2)
  $"trimmed string" <- w2
