vi "CSM - Convert Data to HexStr.gvi"   [LabVIEW NXG 5.0.0]
# Converts any LabVIEW data type to a HEXSTR format parameter string.
# > [!NOTE] CSM HEXSTR Format Parameters
# > To pass any data type in CSM parameters, CSM provides a default parameter format called HEXSTR for passing any data type.
# > HEXSTR: Converts any LabVIEW data type to a variant, then represents this variant's memory format as a hexadecimal string for passing in CSM parameters.
# > HEXSTR can be safely used as a state parameter without disrupting the parsing of CSM message strings.
# -- Controls --
# - Variant: LabVIEW data, supports any data type through variants
# -- Indicators --
# - HEXSTR: CSM HEXSTR format parameter
inputs:
  "Variant": variant, required  # LabVIEW data, supports any data type through variants
outputs:
  "HEX String (0-9,A-F)": string
diagram:
  Flatten To Byte Array(anything=$Variant) -> (data bytes=w1)
  String To Byte Array(encoding="Extended ASCII", string=w1) -> (unsigned byte array=w2)
  Logical And(w2, 0xF0) -> w3
  Logical Shift(x=w3, y=-4) -> w4
  Is Greater Or Equal(x=w4, y=10) -> w5
  Boolean To 0 Or 1(Boolean=w5) -> (0, 1=w6)
  To Unsigned 8 Bit Integer(number=w6) -> w7
  Multiply(7, w7) -> w8
  Add(48, w8, w4) -> w9
  Logical And(w2, 0xF) -> w10
  # This code was found to be faster than:
  # 1) Using a for loop
  # 2) Using string to number VIs
  Is Greater Or Equal(x=w10, y=10) -> w11
  Boolean To 0 Or 1(Boolean=w11) -> (0, 1=w12)
  To Unsigned 8 Bit Integer(number=w12) -> w13
  Multiply(7, w13) -> w14
  Add(48, w14, w10) -> w15
  Interleave Array(w9, w15) -> w16
  Byte Array To String(encoding="Extended ASCII", unsigned byte array=w16) -> (string=w17)
  $"HEX String (0-9,A-F)" <- w17
