vi "CSM - Convert HexStr to Data.gvi"   [LabVIEW NXG 5.0.0]
# Converts a hexadecimal string parameter back to variant data.
# > [!NOTE] CSM HEXSTR Format Parameters
# > To pass any data type in CSM parameters, CSM provides a default parameter format called HEXSTR for passing any data type.
# > HEXSTR: Converts any LabVIEW data type to a variant, then represents this variant's memory format as a hexadecimal string for passing in CSM parameters.
# > HEXSTR can be safely used as a state parameter without disrupting the parsing of CSM message strings.
# -- Controls --
# - HEXSTR: CSM HEXSTR format parameter
# -- Indicators --
# - Variant: LabVIEW data, supports any data type through variants
inputs:
  "HEX String": string, required
  "error in (no error)": error
outputs:
  "Variant": variant  # LabVIEW data, supports any data type through variants
  "error out": error
diagram:
  case ($"HEX String") {
    frame "" {
      w1 = default
      w2 = $"error in (no error)"
    }
    frame Default {
      String To Byte Array(encoding="Extended ASCII", string=$"HEX String") -> (unsigned byte array=w3)
      Subtract(x=w3, y=48) -> w4
      Is Greater Or Equal(x=w4, y=10) -> w5
      Boolean To 0 Or 1(Boolean=w5) -> (0, 1=w6)
      To Unsigned 8 Bit Integer(number=w6) -> w7
      # This code was found to be faster than:
      # 1) Using a for loop
      # 2) Using string to number VIs
      Multiply(7, w7) -> w8
      Subtract(x=w4, y=w8) -> w9
      Decimate Array(array=w9) -> (out0=w10, out1=w11)
      Logical Shift(x=w10, y=4) -> w12
      Logical Or(w12, w11) -> w13
      Byte Array To String(encoding="Extended ASCII", unsigned byte array=w13) -> (string=w14)
      Unflatten From Byte Array(data bytes=w14, type=variant variant()) -> (error out=w15, value=w1)
      Merge Errors($"error in (no error)", w15) -> (error out=w2)
    }
  }
  $Variant <- w1
  $"error out" <- w2
