vi "Log to Console.gviweb"   [LabVIEW NXG 5.0.0]
inputs:
  "cname": string, required
  "error in": error
outputs:
  "error out": error
uses:
  UtilityJSLI::_support::nxgUtils.jsli::Log to Console
diagram:
  Concatenate Strings("\"", $cname, "\"") -> w1
  call "Log to Console"(arg=w1) -> (error out=w2)
  Merge Errors($"error in", w2) -> (error out=w3)
  $"error out" <- w3
