vi "NavigateToURL.gvi"   [LabVIEW NXG 5.0.0]
inputs:
  "URL": string, required
  "Error In": error
  "history?": bool = TRUE
outputs:
  "Error Out": error
uses:
  UtilityJSLI::_support::URL.jsli::ReplaceWindowLocation
  UtilityJSLI::_support::URL.jsli::SetWindowLocation
diagram:
  case ($"history?") {
    frame False, Default {
      call "ReplaceWindowLocation"(url=$URL, error in=$"Error In") -> (error out=w1)
    }
    frame True {
      call "SetWindowLocation"(url=$URL, error in=$"Error In") -> (error out=w1)
    }
  }
  $"Error Out" <- w1
