vi "ParseURL.gvi"   [LabVIEW NXG 5.0.0]
inputs:
  "error in": error
  "url": string, required
  "base": string
outputs:
  "error out": error
  "url parts": "Def-URLParts.gtype"
types:
  "Def-URLParts.gtype" = cluster{"href": string, "origin": string, "protocol": string, "username": string, "password": string, "host": string, "hostname": string, "port": string, "pathname": string, "search": string, "hash": string}
uses:
  UtilityJSLI::_support::URL.jsli::ParseURL
diagram:
  call "ParseURL"(url=$url, base=$base, error in=$"error in") -> (partsJSON=w1, error out=w2)
  Unflatten From Json(JSON string=w1, error in (no error)=w2, type and defaults="Def-URLParts.gtype" {all zero or empty}) -> (error out=w3, value=w4)
  $"url parts" <- w4
  $"error out" <- w3
