vi "JKI Template.gviweb"   [LabVIEW NXG 5.0.0]
uses:
  UtilityJSLI::API::JKI-NXG::Add State(s) to Queue.gvi
  UtilityJSLI::API::JKI-NXG::Parse State Queue.gvi
  UtilityJSLI::API::Log::Log to Console.gviweb
  UtilityJSLI::API::URL::NavigateToURL.gvi
diagram:
  call "Add State(s) to Queue.gvi"(State(s) in ("")="Macro: Initialize") -> (States Out=w1)
  s1 = w1  # shift register
  s2 = no error  # shift register
  s3 = cluster{"name": string, "data": string} {all zero or empty}  # shift register
  while {
    call "Parse State Queue.gvi"(State Queue=s1, Error In (no error)=s2) -> (Remaining States=w2, Current State=w3, Arguments=w4)
    case (w3) ignore case {
      frame "----------- Core -----------" {
        w5 = w2
        w6 = s2
        w7 = s3
      }
      frame Default {
        Format Into String(formatString="State '%s' is not handled.", w3) -> w8
        One Button Dialog(message=w8)
        call "Log to Console.gviweb"(cname=w8, error in=s2) -> (error out=w6)
        w5 = w2
        w7 = s3
      }
      frame "", "Idle" {
        event (timeout = -1) {
          on "Timeout" {
            call "Add State(s) to Queue.gvi"(State(s) in ("")=w2) -> (States Out=w5)
            w6 = s2
            w7 = s3
          }
        }
      }
      frame "Error Handler" {
        w5 = w2
        w6 = s2
        w7 = s3
      }
      frame "----------- Macro -----------" {
        w5 = w2
        w6 = s2
        w7 = s3
      }
      frame "Macro: Initialize" {
        call "Add State(s) to Queue.gvi"(State(s) in Front ("")="Data: validate token\nUI: Initialize", State(s) in ("")=w2) -> (States Out=w5)
        w6 = s2
        w7 = s3
      }
      frame "-------- UI ----------" {
        w5 = w2
        w6 = s2
        w7 = s3
      }
      frame "UI: Initialize" {
        w5 = w2
        w6 = s2
        w7 = s3
      }
      frame "UI: update" {
        w5 = w2
        w6 = s2
        w7 = s3
      }
      frame "----------- Data -----------" {
        w5 = w2
        w6 = s2
        w7 = s3
      }
      frame "Data: validate token" {
        Select(s=TRUE, t="", f="Navigate: To homepage") -> w9
        call "Add State(s) to Queue.gvi"(State(s) in Front ("")=w9, State(s) in ("")=w2) -> (States Out=w5)
        w6 = s2
        w7 = s3
      }
      frame "----------- Navigate -----------" {
        w5 = w2
        w6 = s2
        w7 = s3
      }
      frame "Navigate: To Login.html" {
        call "NavigateToURL.gvi"(history?=FALSE, URL="login.html", Error In=s2) -> (Error Out=w6)
        w5 = w2
        w7 = s3
      }
      frame "Navigate: To homepage" {
        call "NavigateToURL.gvi"(history?=FALSE, URL="/", Error In=s2) -> (Error Out=w6)
        w5 = w2
        w7 = s3
      }
    }
    call "Log to Console.gviweb"(cname=w3, error in=s2)
    next s1 = w5
    next s2 = w6
    next s3 = w7
    stop if FALSE
  }
