vi "UserEvent Template.gviweb"   [LabVIEW NXG 5.0.0]
uses:
  UtilityJSLI::API::Log::Log to Console.gviweb
  NI::G Core::Error::Clear Error Cluster.gvi
diagram:
  Create User Event(user event data type=cluster{"name": string, "data": string} {all zero or empty}) -> (error out=w1, user event out=w2)
  Register For Events("Unnamed event"=w2, error in=w1) -> (error out=w3, event registration refnum out=w4)
  w5 = cluster{"name": string, "data": string} {"name"="Initilalize", "data"=""}
  Generate User Event(error in=w3, event data=w5, user event=w2) -> (error out=w6, user event out=w7)
  s1 = w6  # shift register
  s2 = cluster{"name": string, "data": string} {all zero or empty}  # shift register
  while {
    case (s1) {
      frame Error, Default {
        Property Node(instance in=s1) -> ("code"=w10, "source"=w11)
        Format Into String(formatString="Error %d: %s", w10, w11) -> w12
        call "Log to Console.gviweb"(cname=w12, error in=s1) -> (error out=w13)
        call "Clear Error Cluster.gvi"(error in=w13) -> (error out=w8)
        w9 = s2
      }
      frame No Error {
        event (timeout = -1) (dynamic events = w4) {
          on "Timeout" {
            w8 = s1
            w9 = s2
          }
          on dynamic event 0 {
            Event Data() -> ("name"=w14, "data"=w15)
            case (w14) ignore case {
              frame "Initilalize" {
                w16 = cluster{"name": string, "data": string} {"name"="Validate Token", "data"=""}
                Generate User Event(error in=s1, event data=w16, user event=w7) -> (error out=w8)
              }
              frame "Validate Token" {
                w8 = s1
              }
              frame Default {
                w8 = s1
              }
            }
            call "Log to Console.gviweb"(cname=w14, error in=s1)
            w9 = s2
          }
        }
      }
    }
    next s1 = w8
    next s2 = w9
    stop if FALSE
  }
