vi "-ParsingURL.gviweb"   [LabVIEW NXG 5.0.0]
panel controls:
  "navigate": bool
panel indicators:
  "window location": string
  "relative url": T1
  "current url": T1
  "search": string
  "search params": cluster{"key": string, "value": string}[]
types:
  T1 = cluster{"href": string, "origin": string, "protocol": string, "username": string, "password": string, "host": string, "hostname": string, "port": string, "pathname": string, "search": string, "hash": string}
uses:
  UtilityJSLI::API::URL::GetURL.gvi
  UtilityJSLI::API::URL::ParseURL.gvi
  UtilityJSLI::API::URL::ParseURLSearchParams.gvi
  UtilityJSLI::API::URL::NavigateToURL.gvi
diagram:
  call "GetURL.gvi"() -> (url=w1)
  $"window location" <- w1
  call "ParseURL.gvi"(url=w1) -> (url parts=w2)
  Property Node(instance in=w2) -> ("search"=w3)
  $search <- w3
  $"current url" <- w2
  call "ParseURLSearchParams.gvi"(search=w3) -> (search params=w4)
  $"search params" <- w4
  w5 = "../index.html"  # relative url
  call "ParseURL.gvi"(url=w5, base=w1) -> (url parts=w6)
  $"relative url" <- w6
  while {
    event {
      on "navigate" Value changed {
        call "NavigateToURL.gvi"(URL="https://www.ni.com")
      }
    }
    stop if FALSE
  }
