vi "-SetAttributeOnSelectedElements.gviweb"   [LabVIEW NXG 5.0.0]
panel controls:
  "Example Control with class set in right rail to target from CSS": string = "https://www.google.com"
  "Another Example Control with the same class added so both are targetted": string = "https://www.ni.com"
  "selector": bool
uses:
  UtilityJSLI::API::Attribute::SetAttribute.gviweb
diagram:
  call "SetAttribute.gviweb"(selector=".set-target-parent", attribute name="label-alignment", attribute value="top-right") -> (error out=w1)
  # Place setup code before the loop. For example, perform initial data communication and wire the results into the loop.
  # Top-Level WebVIs usually contain a While Loop that never stops so that they can continue running as long as the web page is open in the user's web browser.
  while (after w1) {
    case ($selector) {
      frame False, Default { }
      frame True {
        call "SetAttribute.gviweb"(selector=".set-target-parent", attribute name="target2", attribute value="_parent2")
      }
    }
    Wait(time to wait=50)
    stop if FALSE
  }
