vi "SetInnerHTML.gviweb"   [LabVIEW NXG 5.0.0]
panel controls:
  "Text": string = "WebVIs Rock! 🤘"
panel indicators:
  "URL Image": string
uses:
  Experiment-WebUI::_support::Create SVG Circle with Text.gvi
  UtilityJSLI::API::Attribute::Set Inner Html.gvi
diagram:
  while {
    event {
      on "Text" Value changed {
        Event Data() -> ("New Value"=w1)
        # w2: html string
        call "Create SVG Circle with Text.gvi"(text=w1) -> (svg=w2)
        call "Set Inner Html.gvi"(selector=".my-container", html=w2)
      }
    }
    stop if FALSE
  }
  # w3: html string
  call "Create SVG Circle with Text.gvi"(text=$Text) -> (svg=w3)
  call "Set Inner Html.gvi"(selector=".my-container", html=w3)
