vi "VI Tree - error.gvi"   [LabVIEW Platform Developer Preview 0.1.0]
uses:
  OpenG.Error::Build Error Cluster.gvi
  OpenG.Error::Case (Error IO).gvi
  OpenG.Error::Error Codes Ring Constant.gvi
  OpenG.Error::Error Constant.gvi
  OpenG.Error::Clear All Errors.gvi
  OpenG.Error::Filter Error Codes (Array).gvi
diagram:
  call "Build Error Cluster.gvi"(code=0)
  call "Case (Error IO).gvi"()
  call "Error Codes Ring Constant.gvi"()
  call "Error Constant.gvi"()
  call "Clear All Errors.gvi"(Error In=no error)
  call "Filter Error Codes (Array).gvi"(Error Codes to Filter=i32[] [], Error In=no error)
