vi "VI Tree - md5.gvi"   [LabVIEW Platform Developer Preview 0.1.0]
uses:
  OpenG.MD5::MD5 Message Digest (Binary String).gvi
  OpenG.MD5::MD5 Hash.gvi
  OpenG.MD5::MD5 F function.gvi
  OpenG.MD5::MD5 FGHI functions.gvi
  OpenG.MD5::MD5 G function.gvi
  OpenG.MD5::MD5 H function.gvi
  OpenG.MD5::MD5 I function.gvi
  OpenG.MD5::MD5 Padding.gvi
  OpenG.MD5::MD5 ti.gvi
  OpenG.MD5::MD5 Unrecoverable character padding.gvi
diagram:
  sequence {  # Public
    frame 0 {
      call "MD5 Message Digest (Binary String).gvi"(Message="")
      call "MD5 Hash.gvi"(Input String="")  # MD5 Hash?
    }
  }
  sequence {  # Private
    frame 0 {
      call "MD5 F function.gvi"()
      call "MD5 FGHI functions.gvi"()
      call "MD5 G function.gvi"()
      call "MD5 H function.gvi"()
      call "MD5 I function.gvi"()
      call "MD5 Padding.gvi"()
      call "MD5 ti.gvi"()
    }
  }
  sequence {  # Utilities
    frame 0 {
      call "MD5 Unrecoverable character padding.gvi"()
    }
  }
