vi "String to 1D Array.gvi"   [G Web Development Software 22.0.0]
# Converts delimited string to a 1D array.
inputs:
  "string": string, required
  "delimiter (Tab)": string = "\t"
outputs:
  "Array of Strings": string[]
diagram:
  Is Empty String Or Path(string/path=$string) -> w1
  case (w1) {
    frame True {
      w2 = string[] []
    }
    frame False {
      s1 = $string  # shift register
      while (iteration -> i1) {
        Match Pattern(regular expression=$"delimiter (Tab)", string=s1) -> (after substring=w3, before substring=w4, offset past match=w5)
        Is Less Than 0(x=w5) -> w6
        append w4 to w2
        next s1 = w3
        stop if w6
      }
    }
  }
  $"Array of Strings" <- w2
