vi "VI Tree - string.gvi"   [LabVIEW Platform Developer Preview 0.1.0]
uses:
  OpenG.String::Format Variant Into String.gvi
  OpenG.String::Convert EOLs (String).gvi
  OpenG.String::Scan Variant from String.gvi
  OpenG.String::Multi-line String to Array.gvi
  OpenG.String::Variant Array to Spreadsheet.gvi
  OpenG.String::Place Number to Proper Engl Text.gvi
  OpenG.String::Number to Proper Engl Text.gvi
  OpenG.String::To Camel Case (String).gvi
  OpenG.String::Slice String.gvi
  OpenG.String::To Proper Case (String).gvi
  OpenG.String::Slice String 1.gvi
  OpenG.String::String to 1D Array.gvi
  OpenG.String::Search or Split String.gvi
  OpenG.String::1D Array to String.gvi
  OpenG.String::String to Character Array.gvi
  OpenG.String::Trim Whitespace (String).gvi
  OpenG.String::Comment.gvi
diagram:
  sequence {  # VI Tree - String
    frame 0 {
      call "Format Variant Into String.gvi"(Variant=variant())
      call "Convert EOLs (String).gvi"(String in="")
      call "Scan Variant from String.gvi"(Input String="", Default Value=variant())
      call "Multi-line String to Array.gvi"(string="")
      call "Variant Array to Spreadsheet.gvi"(2D Variant Array=variant[][] [])  # Variant Array to Spreadsheet String
      call "Place Number to Proper Engl Text.gvi"(Numeric=0)  # Place Number to Proper English Text
      call "Number to Proper Engl Text.gvi"(Numeric=0)  # Number to Proper English Text
      call "To Camel Case (String).gvi"(string="")
      call "Slice String.gvi"(string="", slice="")
      call "To Proper Case (String).gvi"(string="")
      call "Slice String 1.gvi"(String="", Subset (i:j)="")
      call "String to 1D Array.gvi"(string="")
      call "Search or Split String.gvi"(string="")
      call "1D Array to String.gvi"(Array of Strings=string[] [])
      call "String to Character Array.gvi"(Input String="")
      call "Trim Whitespace (String).gvi"(String in="")
      call "Comment.gvi"()
    }
  }
