vi "Get Header from TD.gvi"   [LabVIEW Platform Developer Preview 0.1.0]
# Returns the Get Header from TD.
inputs:
  "Type Descriptor": "Type Descriptor.gtype", required
outputs:
  "Type Descriptor Header": "Type Descriptor Header.gtype"  # Holds the info contained in a type descriptor header.
types:
  "Type Descriptor.gtype" = i16[]
  "Type Descriptor Enumeration.gtype" = enum{"<Null>", "I8", "I16", "I32", "I64", "U8", "U16", "U32", "U64", "SGL", "DBL", "EXT", "CSG", "CDB", "CXT", "0x0F", "0x10", "0x11", "0x12", "0x13", "0x14", "Enum U8", "Enum U16", "Enum U32", "Enum U64", "SGL PQ", "DBL PQ", "EXT PQ", "CSG PQ", "CDB PQ", "CXT PQ", "0x1F", "0x20", "Boolean", "0x22", "0x23", "0x24", "0x25", "0x26", "0x27", "0x28", "0x29", "0x2A", "0x2B", "0x2C", "0x2D", "0x2E", "0x2F", "String", "0x31", "Path", "Pict", "0x34", "0x35", "0x36", "DAQ", "0x38", "0x39", "0x3A", "0x3B"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}
  "Type Descriptor Header.gtype" = cluster{"length": u16, "private": u8, "type": "Type Descriptor Enumeration.gtype", "# elements": u16}
  "Type Descriptor Enumeration__ogtk.gtype" = enum{"<Null>", "I8", "I16", "I32", "I64", "U8", "U16", "U32", "U64", "SGL", "DBL", "EXT", "CSG", "CDB", "CXT", "0x0F", "0x10", "0x11", "0x12", "0x13", "0x14", "Enum U8", "Enum U16", "Enum U32", "Enum U64", "SGL PQ", "DBL PQ", "EXT PQ", "CSG PQ", "CDB PQ", "CXT PQ", "0x1F", "0x20", "Boolean", "0x22", "0x23", "0x24", "0x25", "0x26", "0x27", "0x28", "0x29", "0x2A", "0x2B", "0x2C", "0x2D", "0x2E", "0x2F", "String", "0x31", "Path", "Pict", "0x34", "0x35", "0x36", "DAQ", "0x38", "0x39", "0x3A", "0x3B"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}
  "Type Descriptor Header__ogtk.gtype" = cluster{"length": u16, "private": u8, "type": "Type Descriptor Enumeration__ogtk.gtype", "# elements": u16}
diagram:
  Array Index(array=$"Type Descriptor") -> (out0[_]=w1, out1[_]=w2, out2[_]=w3)
  Split Number(x=w2) -> (high(x)=w4, low(x)=w5)
  Property Node(instance in="Type Descriptor Header__ogtk.gtype" {all zero or empty}, "length"=w1, "private"=w4, "type"=w5, "# elements"=w3) -> (instance out=w6)
  $"Type Descriptor Header" <- w6
