vi "Get Refnum Type Enum from TD.gvi"   [LabVIEW Platform Developer Preview 0.1.0]
# Gets a Refnum Subtype Enumeration from a Type Descriptor Array.
inputs:
  "Type Descriptor": "Type Descriptor.gtype", required
outputs:
  "Refnum Subtype Enum": "Refnum Subtype Enum.gtype"
types:
  "Refnum Subtype Enum.gtype" = enum{"Generic", "Datalog File Refnum", "Byte Stream File Refnum", "Device Refnum", "Occurence Refnum", "TCP Connection Refnum", "VISA Refnum (Obsolete)", "Automation Renum", "VI Server Refnum", "Menu Refnum", "IVI Refnum (Obsolete)", "IMAQ Session", "0x0C", "Datasocket Refnum", "VISA Resource", "IVI Logical Name", "UDP Connection Refnum", "Notifier Refnum", "Queue Refnum", "IrDA Refnum", "Hardware Plugin Refnum", "Hardware Plugin Tag Refnum", "DAQmx Refnum", "Event Registration Refnum", ".NET Refnum", "User Event Refnum", "0x1A", "Event Callback", "0x1C", "0x1D", "Only Used Internal to LabVIEW", "Bluetooth", "Data Value References", "RT FIFO", "TDM Streaming"}
  "Type Descriptor.gtype" = i16[]
diagram:
  Array Index(array=$"Type Descriptor") -> (out0[2]=w1)
  Split Number(x=w1) -> w2
  # '# elements' returns the refnum subtype
  # See: http://zone.ni.com/reference/en-XX/help/371361B-01/lvconcepts/type_descriptors/
  $"Refnum Subtype Enum" <- w2
