vi "Get Waveform Type Enum from TD.gvi"   [LabVIEW Platform Developer Preview 0.1.0]
# Gets a Waveform Subtype Enumeration from a Type Descriptor Array.
inputs:
  "Type Descriptor": "Type Descriptor.gtype", required
outputs:
  "Waveform Subtype Enum": "Waveform Subtype Enum.gtype"
types:
  "Waveform Subtype Enum.gtype" = enum{"<Not a Waveform Type>", "0x01", "Analog 16-bit signed", "Analog Double-Precision", "0x04", "Analog Single Precision", "Timestamp", "Digital Data", "Digital Waveform", "Dynamic Data", "Analog Extended-Precision", "Analog 8-bit unsigned", "Analog 16-bit unsigned", "Analog 32-bit unsigned", "Analog 8-bit signed", "Analog 32-bit signed", "Analog Complex Single-Precision", "Analog Complex Double-Precision", "Analog Complex Extended Precision", "Analog 64-bit signed", "Analog 64-bit unsigned"}
  "Type Descriptor.gtype" = i16[]
diagram:
  Array Index(array=$"Type Descriptor") -> (out0[2]=w1)
  Split Number(x=w1) -> w2
  # '# elements' returns the waveform subtype
  # See: http://zone.ni.com/reference/en-XX/help/371361B-01/lvconcepts/type_descriptors/
  $"Waveform Subtype Enum" <- w2
