vi "Function.gviweb"   [G Web Development Software 22.0.0]
panel controls:
  "String": string
  "Default(0)": f64
panel indicators:
  "Float": f64
  "Unit String": string
  "string_2": string
uses:
  Library::Trim Both Whitespace.gvi
  Library::Replace Tokens in String.gvi
  Library::Match Multiple Pattern_csm.gvi
diagram:
  call "Trim Both Whitespace.gvi"(string=$String) -> (trimmed string=w1)  # Trim Both Whitespace (CSM)
  case (w1) ignore case {
    frame "" {
      w2 = $"Default(0)"
      w3 = default
    }
    frame "e" {
      w2 = 2.71828182846
      w3 = default
    }
    frame "-e" {
      Multiply(-1, 2.71828182846) -> w2
      w3 = default
    }
    frame "-pi" {
      Multiply(-1, 3.14159265359) -> w2
      w3 = default
    }
    frame "pi" {
      w2 = 3.14159265359
      w3 = default
    }
    frame "+inf", "inf" {
      w2 = Inf
      w3 = default
    }
    frame "-inf" {
      w2 = -Inf
      w3 = default
    }
    frame "NaN" {
      w2 = NaN
      w3 = default
    }
    frame Default {
      call "Replace Tokens in String.gvi"(String=w1, search string=",", replace all? (F)=TRUE) -> (string_2=w4)
      Match Pattern(regular expression="[eE][+-]", string=w4) -> (offset past match=w5)
      Is Greater Or Equal To 0(x=w5) -> w6
      case (w6) {
        frame True {
          Match Pattern(regular expression="[eE+-0-9.]+", string=w4) -> (after substring=w7, match substring=w8)
        }
        frame False {
          Match Pattern(regular expression="[eE+-0-9.]+[mMkKuUnGpTfPazyEZY]?", string=w4) -> (after substring=w7, match substring=w8)
        }
      }
      call "Trim Both Whitespace.gvi"(string=w7) -> (trimmed string=w3)  # Trim Both Whitespace (CSM)
      call "Trim Both Whitespace.gvi"(string=w8) -> (trimmed string=w9)  # Trim Both Whitespace (CSM)
      w10 = "[eE][+-] | [m]$ | [M]$ | [kK]$ | [uU]$ | [n]$ | [G]$ | [p]$ | [T]$ | [f]$ | [P]$ | [a]$ | [z]$ | [y]$ | [E]$ | [Z]$ | [Y]$"
      call "Match Multiple Pattern_csm.gvi"(string=w9, regular expression=w10) -> (pattern matched=w11, before substring=w12, match substring=w13, after substring=w14, Found?=w15)  # Match multiple Pattern (CSM)
      case (w11) {
        frame Default {
          Floating Point String To Number(string=w9) -> (number=w2)
        }
        frame "[m]$" {
          Floating Point String To Number(string=w9) -> (number=w16)
          Multiply(0.001, w16) -> w2
        }
        frame "[M]$" {
          Floating Point String To Number(string=w9) -> (number=w17)
          Multiply(1000000, w17) -> w2
        }
        frame "[uU]$" {
          Floating Point String To Number(string=w9) -> (number=w18)
          Multiply(1e-06, w18) -> w2
        }
        frame "[n]$" {
          Floating Point String To Number(string=w9) -> (number=w19)
          Multiply(1e-09, w19) -> w2
        }
        frame "[G]$" {
          Floating Point String To Number(string=w9) -> (number=w20)
          Multiply(1000000000, w20) -> w2
        }
        frame "[T]$" {
          Floating Point String To Number(string=w9) -> (number=w21)
          Multiply(1e+12, w21) -> w2
        }
        frame "[P]$" {
          Floating Point String To Number(string=w9) -> (number=w22)
          Multiply(1e+15, w22) -> w2
        }
        frame "[p]$" {
          Floating Point String To Number(string=w9) -> (number=w23)
          Multiply(1e-12, w23) -> w2
        }
        frame "[f]$" {
          Floating Point String To Number(string=w9) -> (number=w24)
          Multiply(1e-15, w24) -> w2
        }
        frame "[kK]$" {
          Floating Point String To Number(string=w9) -> (number=w25)
          Multiply(1000, w25) -> w2
        }
        frame "[a]$" {
          Floating Point String To Number(string=w9) -> (number=w26)
          Multiply(1e-18, w26) -> w2
        }
        frame "[z]$" {
          Floating Point String To Number(string=w9) -> (number=w27)
          Multiply(1e-21, w27) -> w2
        }
        frame "[y]$" {
          Floating Point String To Number(string=w9) -> (number=w28)
          Multiply(1e-24, w28) -> w2
        }
        frame "[E]$" {
          Floating Point String To Number(string=w9) -> (number=w29)
          Multiply(1e+18, w29) -> w2
        }
        frame "[Z]$" {
          Floating Point String To Number(string=w9) -> (number=w30)
          Multiply(1e+21, w30) -> w2
        }
        frame "[Y]$" {
          Floating Point String To Number(string=w9) -> (number=w31)
          Multiply(1e+24, w31) -> w2
        }
        frame "[eE][+-]" {
          Floating Point String To Number(string=w12) -> (number=w32)
          Concatenate Strings(w13, w14) -> w33
          Match Pattern(regular expression="[eE]", string=w33) -> (after substring=w34)
          Decimal String To Number(string=w34) -> (number=w35)
          disable {
            frame Enabled {
              s1 = 1  # shift register
              for (N = w35) {
                Multiply(s1, 10) -> w37
                next s1 = w37
              }
              w36 = s1
            }
            frame Disabled {
              To Double Precision Float(number=w35) -> w38
              Power Of 10(x=w38) -> w36
            }
          }
          Multiply(w32, w36) -> w2
        }
      }
      $string_2 <- w4
    }
  }
  $"Unit String" <- w3
  $Float <- w2
