vi "TEST-CSM-APIString.gviweb"   [G Web Development Software 22.0.0]
panel controls:
  "Boolean String": string
  "Float String": string
  "Numeric String": string
  "string": string
  "delimiter (Tab)": string = "\t"
panel indicators:
  "Boolean": bool
  "Float": f64
  "Numeric(I64)": u64
  "Array of Strings": string[]
uses:
  Library::String to Boolean_csm.gvi
  Library::String To Float_csm.gvi
  Library::String To Number(I64)_csm.gvi
  OpenG.String::String to 1D Array.gvi
diagram:
  while {
    call "String to Boolean_csm.gvi"(String=$"Boolean String") -> (Boolean=w1)
    $Boolean <- w1
    call "String To Float_csm.gvi"(String=$"Float String") -> (Float=w2)
    $Float <- w2
    Wait(time to wait=100)
    call "String To Number(I64)_csm.gvi"(String=$"Numeric String") -> (Numeric(I64)=w3)
    $"Numeric(I64)" <- w3
    call "String to 1D Array.gvi"(string=$string, delimiter (Tab)=$"delimiter (Tab)") -> (Array of Strings=w4)
    $"Array of Strings" <- w4
    stop if FALSE
  }
