vi "index.gviweb"   [G Web Development Software 22.3.0]
panel indicators:
  "error out": error
  "Web Time": timestamp
  "window location": string
  "relative url": T1
  "current url": T1
  "URL Request": string
  "Time From Web Service": string
  "error out_2": error
  "URL Request_2": string
  "Graph": f64[]
types:
  T1 = cluster{"href": string, "origin": string, "protocol": string, "username": string, "password": string, "host": string, "hostname": string, "port": string, "pathname": string, "search": string, "hash": string}
uses:
  UtilityJSLI::API::URL::GetURL.gvi
  UtilityJSLI::API::URL::ParseURL.gvi
  NI::HTTP::POST Buffer.gvi
diagram:
  # Top-Level WebVIs usually contain a While Loop that never stops so that they can continue running as long as the web page is open in the user's web browser.
  while {
    call "GetURL.gvi"() -> (url=w1)
    call "ParseURL.gvi"(url="CSM-RunScript", base=w1) -> (url parts=w2)
    Property Node(instance in=w2) -> ("href"=w3)
    $"URL Request" <- w3
    call "POST Buffer.gvi"(url=w3, buffer="API: Get Current Time  -@ CSM") -> (body=w4, error out=w5)
    $"Time From Web Service" <- w4
    $"error out" <- w5
    call "GetURL.gvi"() -> (url=w6)
    call "ParseURL.gvi"(url="CSM-RunScript", base=w6) -> (url parts=w7)
    Property Node(instance in=w7) -> ("href"=w8)
    $"URL Request_2" <- w8
    call "POST Buffer.gvi"(url=w8, buffer="API: Waveform -@ CSM") -> (body=w9, error out=w10)
    Unflatten From Json(JSON string=w9, type and defaults=f64[] []) -> (value=w11)
    $Graph <- w11
    $"error out_2" <- w10
    Wait(time to wait=500)
    Get Current Time() -> (current time=w12)
    $"Web Time" <- w12
    stop if FALSE
  }
  call "GetURL.gvi"() -> (url=w13)
  # Place setup code before the loop. For example, perform initial data communication and wire the results into the loop.
  $"window location" <- w13
  call "ParseURL.gvi"(url=w13) -> (url parts=w14)
  $"current url" <- w14
  w15 = "../index.html"  # relative url
  call "ParseURL.gvi"(url=w15, base=w13) -> (url parts=w16)
  $"relative url" <- w16
